# Grasshopper definition GH_Py_Geo2Graph.gh (Grasshopper 1.0.8)
# plug-ins: Human

geometry_pipeline = GeometryPipeline(
    GroupByLayer=False,
    GroupByType=False,
    IncludeHidden=True,
    IncludeLocked=True,
    LayerFilter="*PLOT",
    NameFilter="*",
    SublayerFiltering=True,
    TypeFilter=4)
geometry_pipeline_2 = GeometryPipeline(
    GroupByLayer=False,
    GroupByType=False,
    IncludeHidden=True,
    IncludeLocked=True,
    LayerFilter="*MASSING",
    NameFilter="*",
    SublayerFiltering=True,
    TypeFilter=1073741848)
python_3_script = Python3Script(plot=geometry_pipeline, geo_list=geometry_pipeline_2)  # -> out, connection_edges, plot_edges, centers, plot_center; inputs geo_list: list
# ---------- python_3_script: Python ----------
import Rhino.Geometry as rg
import rhinoscriptsyntax as rs

tolerance = 0.01

# geometry list
geo_objects = []
for g in geo_list:
    if isinstance(g, rg.GeometryBase):
        geo_objects.append(g)
    else:
        geo = rs.coercegeometry(g)
        if geo:
            geo_objects.append(geo)

n = len(geo_objects)
centers = []
ground_connected = set()
edges = []

# centroids
for geo in geo_objects:
    centroid = None
    if isinstance(geo, rg.Brep):
        vmp = rg.VolumeMassProperties.Compute(geo)
        if vmp:
            centroid = vmp.Centroid
    if not centroid:
        bbox = geo.GetBoundingBox(True)
        centroid = bbox.Center
    centers.append(centroid)

# touching geometries
for i in range(n):
    for j in range(i + 1, n):
        g1 = geo_objects[i]
        g2 = geo_objects[j]
        try:
            union = rg.Brep.CreateBooleanUnion([g1, g2], tolerance)
            if union and len(union) == 1:
                edges.append((i, j))
        except:
            continue

# touching  plot
plot_crv = None
if isinstance(plot, rg.Polyline):
    plot_crv = plot.ToNurbsCurve()
elif isinstance(plot, rg.PolylineCurve):
    plot_crv = plot.ToNurbsCurve()
elif isinstance(plot, rg.Curve):
    plot_crv = plot

if plot_crv and plot_crv.IsClosed:
    for i, geo in enumerate(geo_objects):
        bbox = geo.GetBoundingBox(True)
        base_z = bbox.Min.Z

        # geometries base close plot
        if abs(base_z) > tolerance:
            continue

        # bottom face corners
        corners = [
            rg.Point3d(bbox.Min.X, bbox.Min.Y, base_z),
            rg.Point3d(bbox.Max.X, bbox.Min.Y, base_z),
            rg.Point3d(bbox.Min.X, bbox.Max.Y, base_z),
            rg.Point3d(bbox.Max.X, bbox.Max.Y, base_z)
        ]

        # projected base corner inside plot
        for pt in corners:
            pt_proj = rg.Point3d(pt.X, pt.Y, 0)
            if plot_crv.Contains(pt_proj) != rg.PointContainment.Outside:
                ground_connected.add(i)
                break



# plot edges
plot_center = None
plot_center_geom = rg.AreaMassProperties.Compute(plot_crv)
if plot_center_geom:
    plot_center = plot_center_geom.Centroid

if plot_center:
    plot_edges = []
    for i in ground_connected:
        pt = centers[i]
        plot_edges.append(rg.Line(plot_center, pt))
else:
    plot_edges = []

# geometry-to-geometry edges
connection_edges = []
for i, j in edges:
    pt1 = centers[i]
    pt2 = centers[j]
    connection_edges.append(rg.Line(pt1, pt2))
# ---------- end python_3_script ----------

edges = Data(python_3_script.plot_edges)
edges_2 = Data(python_3_script.connection_edges)
merge = Merge(Data1=edges, Data2=edges_2)  # -> flatten(Result)
edges_3 = Data(merge)

nodes = Data(python_3_script.centers)
nodes_2 = Data(python_3_script.plot_center)
merge_2 = Merge(Data1=nodes, Data2=nodes_2)  # -> flatten(Result)
nodes_3 = Data(merge_2)

vscode = FilePath("C:\Users\broue\Documents\IAAC MaCAD\Master_Thesis\MaCAD25_Thesis\3D2graph\3D2graph.py")
trigger = Trigger(Interval=5000, TimerInterval=5000)  # disabled
file_path = FilePath("C:\Users\broue\Documents\IAAC MaCAD\Master_Thesis\MaCAD25_Thesis\3D2graph\")
python_3_script_2 = Python3Script(edges=edges_3, nodes=nodes_3, path=file_path)  # -> graph, node_points, edge_lines; inputs edges: list, nodes: list, path: String
# ---------- python_3_script_2: Python ----------
import Rhino.Geometry as rg
import networkx as nx

# Build graph
G = nx.Graph()
for i, pt in enumerate(nodes):
    G.add_node(i, pos=(pt.X, pt.Y, pt.Z))

index_edges = []
for edge in edges:
    try:
        pt1 = edge.PointAtStart
        pt2 = edge.PointAtEnd
        i1 = nodes.index(pt1)
        i2 = nodes.index(pt2)
        index_edges.append((i1, i2))
    except:
        pass

G.add_edges_from(index_edges)

# Prepare output
graph_lines = []
graph_nodes = []

for i in G.nodes:
    x, y, z = G.nodes[i]['pos']
    graph_nodes.append(rg.Point3d(x, y, z))

for u, v in G.edges:
    p1 = G.nodes[u]['pos']
    p2 = G.nodes[v]['pos']
    graph_lines.append(rg.Line(rg.Point3d(*p1), rg.Point3d(*p2)))

# Outputs
node_points = graph_nodes
edge_lines = graph_lines
graph = G


import json
from networkx.readwrite import json_graph

# JSON
data = json_graph.node_link_data(G)


path = path + "graph.json"
print(path)

# Write to file
with open(path, "w") as f:
    json.dump(data, f)
# ---------- end python_3_script_2 ----------
python_3_script_3 = Python3Script(script=vscode, edges=edges_3, nodes=nodes_3, path=file_path)  # -> out, graph, node_points, edge_lines; inputs edges: list, nodes: list, path: String; disabled; same code as python_3_script_2
entwine = Entwine(Branch00=python_3_script_2.node_points, Branch01=python_3_script_2.edge_lines, FlattenInputs=True)
panel = Panel(python_3_script_3.out)
unit_z = UnitZ(Factor=Slider(876, range=0..1000))
move = Move(Geometry=entwine, Motion=unit_z)  # -> Geometry, Transform
explode_tree = ExplodeTree(Data=move.Geometry)  # -> Branch0, Branch1

list_item = ListItem(List=explode_tree.Branch0, Index=0, Wrap=True)
dot_display = DotDisplay(Point=explode_tree.Branch0, Colour=RGB(0, 0, 0), Size=Slider(6.6, range=0..15))
custom_preview_lineweights = CustomPreviewLineweights(
    Geometry=explode_tree.Branch1,
    Shader=ColourSwatch(SwatchColor=RGB(0, 0, 0)),
    Thickness=Slider(2.8, range=0..5),
    Absolute=Toggle(True))
dot_display_2 = DotDisplay(Point=list_item, Colour=RGB(0, 0, 0), Size=Slider(12.5, range=0..15))
