# Grasshopper definition GH_Py_massing2graph.gh (Grasshopper 1.0.8)
# plug-ins: Human

geometry_pipeline = GeometryPipeline(
    GroupByLayer=False,
    GroupByType=False,
    IncludeHidden=True,
    IncludeLocked=True,
    LayerFilter="*PLOT",
    NameFilter="*",
    SublayerFiltering=True,
    TypeFilter=4)
geometry_pipeline_2 = GeometryPipeline(
    GroupByLayer=False,
    GroupByType=False,
    IncludeHidden=True,
    IncludeLocked=True,
    LayerFilter="*MASSING",
    NameFilter="*",
    SublayerFiltering=True,
    TypeFilter=1073741848)
vscode = FilePath("C:\Users\broue\Documents\IAAC MaCAD\Master_Thesis\MaCAD25_Thesis\2_3D2graph\massing2graph.py")
python_3_script = Python3Script(x=vscode)  # -> out
# ---------- python_3_script: Python ----------
import os

directory = os.path.dirname(x)

print(directory)
# ---------- end python_3_script ----------
panel = Panel(vscode)
python_3_script_2 = Python3Script(
    script=vscode,
    tolerance=Slider(1, range=0..10),
    plot=geometry_pipeline,
    geo_list=geometry_pipeline_2,
    path=python_3_script)  # -> merged_edges_out, merged_points_out, debug_out, graph_out; inputs geo_list: list
#   port script: Script to execute
# ---------- python_3_script_2: Python ----------
import Rhino.Geometry as rg
import networkx as nx

# Build graph
G = nx.Graph()
for i, pt in enumerate(nodes):
    G.add_node(i, pos=(pt.X, pt.Y, pt.Z))

index_edges = []
for edge in edges:
    try:
        pt1 = edge.PointAtStart
        pt2 = edge.PointAtEnd
        i1 = nodes.index(pt1)
        i2 = nodes.index(pt2)
        index_edges.append((i1, i2))
    except:
        pass

G.add_edges_from(index_edges)

# Prepare output
graph_lines = []
graph_nodes = []

for i in G.nodes:
    x, y, z = G.nodes[i]['pos']
    graph_nodes.append(rg.Point3d(x, y, z))

for u, v in G.edges:
    p1 = G.nodes[u]['pos']
    p2 = G.nodes[v]['pos']
    graph_lines.append(rg.Line(rg.Point3d(*p1), rg.Point3d(*p2)))

# Outputs
node_points = graph_nodes
edge_lines = graph_lines
graph = G


import json
from networkx.readwrite import json_graph

# JSON
data = json_graph.node_link_data(G)


path = path + "graph.json"
print(path)

# Write to file
with open(path, "w") as f:
    json.dump(data, f)
# ---------- end python_3_script_2 ----------
entwine = Entwine(Branch00=python_3_script_2.merged_edges_out, Branch01=python_3_script_2.merged_points_out, FlattenInputs=True)
panel_2 = Panel(python_3_script_2.debug_out)
unit_z = UnitZ(Factor=Slider(603, range=0..1000))
move = Move(Geometry=entwine, Motion=unit_z)  # -> Geometry, Transform
explode_tree = ExplodeTree(Data=move.Geometry)  # -> Branch0, Branch1

custom_preview_lineweights = CustomPreviewLineweights(
    Geometry=explode_tree.Branch0,
    Shader=ColourSwatch(SwatchColor=RGB(0, 0, 0)),
    Thickness=Slider(2.8, range=0..5),
    Absolute=Toggle(True))
dot_display = DotDisplay(Point=explode_tree.Branch1, Colour=RGB(0, 0, 0), Size=Slider(6.6, range=0..15))
