# Grasshopper definition graphml_to_GH.gh (Grasshopper 1.0.8)
# plug-ins: Pufferfish, Human

number_slider = Slider(55.0621, range=0..100)
number_slider_2 = Slider(10.6181, range=0..100)

latitude = Slider(55.66, range=0..100)
longitude = Slider(12.5518, range=0..100)

latitude_2 = Slider(55.3743, range=0..100)
longitude_2 = Slider(10.4268, range=0..100)

# ----
# Downloads OSM
downloads_osm = Python3Script(latitude=latitude_2, longitude=longitude_2, buffer_distance=Slider(1000, range=0..1000))  # -> out, street_attributes_output, building_attributes_output, green_space_attributes_output; inputs latitude: Double, longitude: Double, buffer_distance: Double
# ---------- downloads_osm: Python ----------
import os
import osmnx as ox
from shapely.geometry import Polygon, LineString
import Rhino.Geometry as rg
import pandas as pd
from Grasshopper import DataTree
from Grasshopper.Kernel.Data import GH_Path
from osmnx.projection import project_gdf

# Parameters
location_point = (latitude, longitude)  # (lat, lon)
# buffer_distance = 1000  # meters

# OSM tags
tags_streets = {"highway": True}
tags_buildings = {"building": True}
tags_greens = {
    "leisure": ["park", "garden"],
    "landuse": ["grass", "recreation_ground", "cemetery"]
}

# Cache setup
ox.settings.use_cache = True
ox.settings.cache_folder = r"C:\Users\CDH\Documents\GitHub\MaCAD25_Thesis\cache"
os.makedirs(ox.settings.cache_folder, exist_ok=True)

# Download and project data
print("Downloading OSM data...")
gdf_streets = project_gdf(ox.features_from_point(location_point, tags=tags_streets, dist=buffer_distance))
gdf_buildings = project_gdf(ox.features_from_point(location_point, tags=tags_buildings, dist=buffer_distance))
gdf_greens = project_gdf(ox.features_from_point(location_point, tags=tags_greens, dist=buffer_distance))

# Geometry conversion
def shapely_to_rhino_and_wkt(geometry):
    if geometry is None:
        return None, None
    if isinstance(geometry, LineString):
        pts = [rg.Point3d(x, y, 0) for x, y in geometry.coords]
        return rg.Polyline(pts), geometry.wkt
    elif isinstance(geometry, Polygon):
        pts = [rg.Point3d(x, y, 0) for x, y in geometry.exterior.coords]
        return rg.Polyline(pts), geometry.wkt
    return None, None

# Clean and transform attributes
def clean_attributes(row, rhino_geom, geom_wkt):
    attr = {}
    for k, v in row.items():
        if pd.isna(v) or k == "geometry":
            continue
        elif isinstance(v, (list, tuple)):
            if len(v) == 0:
                continue
            attr[k] = ",".join(str(i) for i in v)
        else:
            attr[k] = v
    attr["geometry"] = rhino_geom
    attr["geometry_wkt"] = geom_wkt
    return attr

# Process and clean a GeoDataFrame
def process_layer(gdf):
    data_dicts = []
    for _, row in gdf.iterrows():
        rhino_geom, geom_wkt = shapely_to_rhino_and_wkt(row.geometry)
        if rhino_geom:
            clean_dict = clean_attributes(row, rhino_geom, geom_wkt)
            data_dicts.append(clean_dict)
    return data_dicts

# Convert list of dicts to DataTree
def list_of_dicts_to_datatree(list_dicts):
    tree = DataTree[object]()
    for i, d in enumerate(list_dicts):
        path = GH_Path(i)
        tree.Add(d, path)
    return tree

# Process each layer
street_data = process_layer(gdf_streets)
building_data = process_layer(gdf_buildings)
green_data = process_layer(gdf_greens)

# Final outputs (only attributes, including geometry + wkt inside)
street_attributes_output = list_of_dicts_to_datatree(street_data)
building_attributes_output = list_of_dicts_to_datatree(building_data)
green_space_attributes_output = list_of_dicts_to_datatree(green_data)
# ---------- end downloads_osm ----------
path = FilePath("C:\Users\CDH\Documents\GitHub\MaCAD25_Thesis\knowledge\streets_graph.graphml")
path_2 = FilePath("C:\Users\CDH\Documents\GitHub\MaCAD25_Thesis\knowledge\urban_graph.graphml")
path_3 = FilePath("C:\Users\CDH\Documents\GitHub\MaCAD25_Thesis\knowledge\streets_graph.graphml")
path_4 = FilePath("C:\Users\CDH\Documents\GitHub\MaCAD25_Thesis\knowledge\urban_graph.graphml")

# ---- group: Loads .graphml
py3 = Python3Script(streets_graph_path=path, urban_graph_path=path_2, reload_trigger=Button())  # -> out, nodes_buildings, edges_buildings, buildings, nodes_streets, streets; inputs streets_graph_path: String, urban_graph_path: String, reload_trigger: Boolean
# ---------- py3: Python ----------
# ----------------------------
# Node A: Load GraphML (Urban + Streets)
# ----------------------------
import Rhino.Geometry as rg
import networkx as nx
import os
from shapely import wkt
from Grasshopper import DataTree
from Grasshopper.Kernel.Data import GH_Path

def load_graphs(urban_path, streets_path):
    if not os.path.exists(urban_path):
        raise ValueError(f"Urban GraphML not found: {urban_path}")
    if not os.path.exists(streets_path):
        raise ValueError(f"Streets GraphML not found: {streets_path}")

    # Load graphs
    G_urban = nx.read_graphml(urban_path)
    G_streets = nx.read_graphml(streets_path)

    urban_nodes_tree = DataTree[object]()
    urban_geometries_tree = DataTree[object]()
    urban_edges = []
    street_nodes = []
    street_edges = []

    # Urban nodes and geometries by type
    for node_id, data in G_urban.nodes(data=True):
        node_type = data.get("type", "unknown")
        x, y = float(data["x"]), float(data["y"])
        pt = rg.Point3d(x, y, 0)

        if node_type == "building":
            branch = GH_Path(0)
        elif node_type == "public_space":
            branch = GH_Path(1)
        else:
            continue  # Skip street nodes or unknown types

        urban_nodes_tree.Add(pt, branch)

        geom_wkt = data.get("geometry_wkt")
        if geom_wkt:
            shape = wkt.loads(geom_wkt)
            if shape.geom_type == "Polygon":
                pts = [rg.Point3d(*p, 0) for p in shape.exterior.coords]
                poly = rg.Polyline(pts)
                urban_geometries_tree.Add(poly, branch)
            else:
                urban_geometries_tree.Add(None, branch)
        else:
            urban_geometries_tree.Add(None, branch)

    # Urban edges (same list for all)
    for u, v in G_urban.edges():
        u_data, v_data = G_urban.nodes[u], G_urban.nodes[v]
        line = rg.Line(
            rg.Point3d(float(u_data["x"]), float(u_data["y"]), 0),
            rg.Point3d(float(v_data["x"]), float(v_data["y"]), 0)
        )
        urban_edges.append(line)

    # Street nodes
    for node_id, data in G_streets.nodes(data=True):
        pt = rg.Point3d(float(data["x"]), float(data["y"]), 0)
        street_nodes.append(pt)

    # Street edges
    for u, v, data in G_streets.edges(data=True):
        geom_wkt = data.get("geometry_wkt")
        if geom_wkt:
            try:
                linestring = wkt.loads(geom_wkt)
                if linestring.geom_type == "LineString":
                    pts = [rg.Point3d(x, y, 0) for x, y in linestring.coords]
                    polyline = rg.Polyline(pts)
                    street_edges.append(polyline)
                else:
                    # Fallback: draw simple straight line
                    u_data = G_streets.nodes[u]
                    v_data = G_streets.nodes[v]
                    line = rg.Line(
                        rg.Point3d(float(u_data["x"]), float(u_data["y"]), 0),
                        rg.Point3d(float(v_data["x"]), float(v_data["y"]), 0)
                    )
                    street_edges.append(line)
            except:
                # Fallback in case of WKT parsing error
                u_data = G_streets.nodes[u]
                v_data = G_streets.nodes[v]
                line = rg.Line(
                    rg.Point3d(float(u_data["x"]), float(u_data["y"]), 0),
                    rg.Point3d(float(v_data["x"]), float(v_data["y"]), 0)
                )
                street_edges.append(line)
        else:
            # No geometry_wkt: fallback straight line
            u_data = G_streets.nodes[u]
            v_data = G_streets.nodes[v]
            line = rg.Line(
                rg.Point3d(float(u_data["x"]), float(u_data["y"]), 0),
                rg.Point3d(float(v_data["x"]), float(v_data["y"]), 0)
            )
            street_edges.append(line)
    return urban_nodes_tree, urban_edges, urban_geometries_tree, street_nodes, street_edges


# Inputs: urban_graph_path, streets_graph_path
# Outputs: a=urban_nodes (split in branches), b=urban_edges, c=urban_geometries (split), d=street_nodes, e=street_edges
nodes_buildings, edges_buildings, buildings, nodes_streets, streets = load_graphs(urban_graph_path, streets_graph_path)
# ---------- end py3 ----------

# ----
# Preview
extract_geometry = Python3Script(dicts_tree=downloads_osm.green_space_attributes_output)  # -> out, geometries_tree; inputs dicts_tree: tree
# ---------- extract_geometry: Python ----------
from Grasshopper import DataTree
from Grasshopper.Kernel.Data import GH_Path

def extract_geometries(dicts_tree):
    geometries_tree = DataTree[object]()
    for path in dicts_tree.Paths:
        items = dicts_tree.Branch(path)
        for i, d in enumerate(items):
            geom = d.get('geometry', None)
            geometries_tree.Add(geom, path)
    return geometries_tree

# Input: dicts_tree (DataTree of dicts)
# Output: geometries_tree (DataTree of geometry)

geometries_tree = extract_geometries(dicts_tree)
# ---------- end extract_geometry ----------
extract_geometry_2 = Python3Script(dicts_tree=downloads_osm.building_attributes_output)  # -> out, geometries_tree; inputs dicts_tree: tree; same code as extract_geometry
extract_geometry_3 = Python3Script(dicts_tree=downloads_osm.street_attributes_output)  # -> out, geometries_tree; inputs dicts_tree: tree; same code as extract_geometry
py3_2 = Python3Script(streets_graph_path=path_3, urban_graph_path=path_4, reload_trigger=Button())  # -> out, urban_nodes, urban_edges, urban_geometries, street_nodes, street_edges, urban_node_dicts_tree, urban_edge_dicts_tree, street_node_dicts_tree, street_edge_dicts_tree; inputs streets_graph_path: String, urban_graph_path: String, reload_trigger: Boolean
# ---------- py3_2: Python ----------
import Rhino.Geometry as rg
import networkx as nx
import os
from shapely import wkt
from Grasshopper import DataTree
from Grasshopper.Kernel.Data import GH_Path

def list_of_dicts_to_datatree(list_dicts):
    tree = DataTree[object]()
    for i, d in enumerate(list_dicts):
        path = GH_Path(0, i)
        tree.Add(d, path)
    return tree

def load_graphs(urban_path, streets_path):
    if not os.path.exists(urban_path):
        raise ValueError(f"Urban GraphML not found: {urban_path}")
    if not os.path.exists(streets_path):
        raise ValueError(f"Streets GraphML not found: {streets_path}")

    G_urban = nx.read_graphml(urban_path)
    G_streets = nx.read_graphml(streets_path)

    # OUTPUTS
    urban_nodes_tree = DataTree[object]()
    urban_geometries_tree = DataTree[object]()
    urban_edges = []
    street_nodes = []
    street_edges = []

    urban_node_dicts = []
    urban_edge_dicts = []
    street_node_dicts = []
    street_edge_dicts = []

    # --- URBAN GRAPH ---
    for node_id, data in G_urban.nodes(data=True):
        x, y = float(data["x"]), float(data["y"])
        pt = rg.Point3d(x, y, 0)

        node_type = data.get("type", "unknown")
        if node_type == "building":
            branch = GH_Path(0)
        elif node_type == "public_space":
            branch = GH_Path(1)
        else:
            continue

        urban_nodes_tree.Add(pt, branch)

        geom_wkt = data.get("geometry_wkt")
        if geom_wkt:
            shape = wkt.loads(geom_wkt)
            if shape.geom_type == "Polygon":
                pts = [rg.Point3d(*p, 0) for p in shape.exterior.coords]
                poly = rg.Polyline(pts)
                urban_geometries_tree.Add(poly, branch)
                data["geometry"] = poly
            else:
                urban_geometries_tree.Add(None, branch)
                data["geometry"] = None
        else:
            urban_geometries_tree.Add(None, branch)
            data["geometry"] = None

        data["point"] = pt
        data["id"] = node_id
        urban_node_dicts.append(data)

    for u, v, edge_data in G_urban.edges(data=True):
        pt1 = rg.Point3d(float(G_urban.nodes[u]["x"]), float(G_urban.nodes[u]["y"]), 0)
        pt2 = rg.Point3d(float(G_urban.nodes[v]["x"]), float(G_urban.nodes[v]["y"]), 0)
        line = rg.Line(pt1, pt2)
        urban_edges.append(line)

        edge_data["geometry"] = line
        edge_data["source"] = u
        edge_data["target"] = v
        urban_edge_dicts.append(edge_data)

    # --- STREET GRAPH ---
    for node_id, data in G_streets.nodes(data=True):
        x, y = float(data["x"]), float(data["y"])
        pt = rg.Point3d(x, y, 0)
        street_nodes.append(pt)

        data["point"] = pt
        data["id"] = node_id
        street_node_dicts.append(data)

    for u, v, edge_data in G_streets.edges(data=True):
        u_data = G_streets.nodes[u]
        v_data = G_streets.nodes[v]
        pt1 = rg.Point3d(float(u_data["x"]), float(u_data["y"]), 0)
        pt2 = rg.Point3d(float(v_data["x"]), float(v_data["y"]), 0)

        geom_wkt = edge_data.get("geometry_wkt")
        if geom_wkt:
            try:
                shapely_geom = wkt.loads(geom_wkt)
                if shapely_geom.geom_type == "LineString":
                    coords = list(shapely_geom.coords)
                    pts = [rg.Point3d(x, y, 0) for x, y in coords]
                    polyline = rg.Polyline(pts)
                    street_edges.append(polyline)
                    edge_data["geometry"] = polyline
                else:
                    # Fallback simple line
                    line = rg.Line(pt1, pt2)
                    street_edges.append(line)
                    edge_data["geometry"] = line
            except:
                line = rg.Line(pt1, pt2)
                street_edges.append(line)
                edge_data["geometry"] = line
        else:
            line = rg.Line(pt1, pt2)
            street_edges.append(line)
            edge_data["geometry"] = line

        edge_data["source"] = u
        edge_data["target"] = v
        street_edge_dicts.append(edge_data)

    # Convert lists of dicts to DataTrees
    urban_node_dicts_tree = list_of_dicts_to_datatree(urban_node_dicts)
    urban_edge_dicts_tree = list_of_dicts_to_datatree(urban_edge_dicts)
    street_node_dicts_tree = list_of_dicts_to_datatree(street_node_dicts)
    street_edge_dicts_tree = list_of_dicts_to_datatree(street_edge_dicts)

    return (
        urban_nodes_tree, urban_edges, urban_geometries_tree,
        street_nodes, street_edges,
        urban_node_dicts_tree, urban_edge_dicts_tree,
        street_node_dicts_tree, street_edge_dicts_tree
    )

# Inputs: urban_graph_path, streets_graph_path
# Outputs:
# a: urban_nodes (DataTree of Points)
# b: urban_edges (list of Lines)
# c: urban_geometries (DataTree of Polylines or None)
# d: street_nodes (list of Points)
# e: street_edges (list of Lines or Polylines)
# f: urban_node_dicts_tree (DataTree of dicts)
# g: urban_edge_dicts_tree (DataTree of dicts)
# h: street_node_dicts_tree (DataTree of dicts)
# i: street_edge_dicts_tree (DataTree of dicts)

urban_nodes, urban_edges, urban_geometries, street_nodes, street_edges, urban_node_dicts_tree, urban_edge_dicts_tree, street_node_dicts_tree, street_edge_dicts_tree = load_graphs(urban_graph_path, streets_graph_path)
# ---------- end py3_2 ----------
py3_3 = Python3Script()  # -> out, a, b, c, d, e, f, g, h, i
# ---------- py3_3: Python ----------
"""Grasshopper Script"""
# requirements: osmnx, shapely, scipy, networkx

import os
import osmnx as ox
from shapely import wkt
import Rhino.Geometry as rg
from Grasshopper import DataTree
from Grasshopper.Kernel.Data import GH_Path
from osmnx.projection import project_gdf

# Parameters
point = (55.6627, 12.5518)  # Latitude, Longitude
dist = 1000  # Buffer distance in meters

# Set up OSMnx cache directory
ox.settings.use_cache = True
ox.settings.cache_folder = r"C:\Users\CDH\Documents\GitHub\MaCAD25_Thesis\cache"
os.makedirs(ox.settings.cache_folder, exist_ok=True)

# Define OSM tags for different layers
tags_streets = {"highway": True}
tags_buildings = {"building": True}
tags_greens = {
    "leisure": ["park", "garden"],
    "landuse": ["grass", "recreation_ground", "cemetery"]
}

# Download data from OpenStreetMap
print("Downloading data...")
gdf_streets = ox.features_from_point(point, tags=tags_streets, dist=dist)
gdf_buildings = ox.features_from_point(point, tags=tags_buildings, dist=dist)
gdf_greens = ox.features_from_point(point, tags=tags_greens, dist=dist)

# Project all GeoDataFrames to the same CRS
gdf_streets = project_gdf(gdf_streets)
gdf_buildings = project_gdf(gdf_buildings)
gdf_greens = project_gdf(gdf_greens)

# Convert shapely geometry to Rhino geometry
def shapely_to_rhino(geom):
    if geom is None:
        return None
    if geom.geom_type == "LineString":
        pts = [rg.Point3d(x, y, 0) for x, y in geom.coords]
        return rg.Polyline(pts)
    elif geom.geom_type == "Polygon":
        pts = [rg.Point3d(x, y, 0) for x, y in geom.exterior.coords]
        return rg.Polyline(pts)
    return None

# Convert GeoDataFrame to Rhino geometries and attribute dictionaries
def convert_layer(gdf):
    rhino_geoms = []
    attributes = []
    for _, row in gdf.iterrows():
        geom = shapely_to_rhino(row.geometry)
        if geom:
            rhino_geoms.append(geom)
            attributes.append(dict(row))
    return rhino_geoms, attributes

# Attribute conversion helpers
def dicts_to_datatree(dicts):
    tree = DataTree[str]()
    for i, d in enumerate(dicts):
        path = GH_Path(i)
        for k, v in d.items():
            tree.Add(f"{k}={v}", path)
    return tree

def dict_list_to_datatree(dicts):
    tree = DataTree[object]()
    for i, d in enumerate(dicts):
        path = GH_Path(i)
        tree.Add(d, path)
    return tree

# Convert layers
streets_rhino, streets_attr = convert_layer(gdf_streets)
buildings_rhino, buildings_attr = convert_layer(gdf_buildings)
greens_rhino, greens_attr = convert_layer(gdf_greens)

# Outputs
a = streets_rhino
b = buildings_rhino
c = greens_rhino
d = dict_list_to_datatree(streets_attr)
e = dict_list_to_datatree(buildings_attr)
f = dict_list_to_datatree(greens_attr)
g = dicts_to_datatree(streets_attr)
h = dicts_to_datatree(buildings_attr)
i = dicts_to_datatree(greens_attr)
# ---------- end py3_3 ----------
crv = Curve(extract_geometry_2.geometries_tree)
crv_2 = Curve(extract_geometry.geometries_tree)
crv_3 = Curve(extract_geometry_3.geometries_tree)
srf = Surface(crv)
srf_2 = Surface(crv_2)
item = ListItem(List=flatten(py3_2.street_edge_dicts_tree), Index=0, Wrap=True)
crv_4 = Curve(graft(py3_3.c))
crv_5 = Curve(py3.edges_buildings)
preview = CustomPreview(Geometry=srf, Material=ColourSwatch(SwatchColor=RGB(158, 158, 158)))
crv_6 = Curve(graft(py3_3.b))
preview_2 = CustomPreview(Geometry=srf_2, Material=ColourSwatch(SwatchColor=RGB(222, 222, 222)))
panel = Panel(item)
pt = Point(py3_2.urban_nodes)
crv_7 = Curve(py3_2.street_edges)
previewlw = CustomPreviewLineweights(Geometry=crv_3, Shader=ColourSwatch(SwatchColor=RGB(0, 0, 0)), Absolute=False)
py3_4 = Python3Script(dicts_tree=py3_3.e)  # -> out, geometries_tree; inputs dicts_tree: tree; same code as extract_geometry

# ---- group: Extract key
py3_5 = Python3Script(dicts_tree=py3_3.e, key_name="name")  # -> out, extracted_tree; inputs dicts_tree: tree, key_name: String
# ---------- py3_5: Python ----------
from Grasshopper import DataTree
from Grasshopper.Kernel.Data import GH_Path

def extract_key_from_datatree(dicts_tree, key_name):
    result_tree = DataTree[object]()
    for path in dicts_tree.Paths:
        branch = dicts_tree.Branch(path)
        extracted_values = []
        for d in branch:
            # d es un dict, extraemos el valor de key_name o None si no existe
            value = d.get(key_name, None)
            extracted_values.append(value)
        result_tree.AddRange(extracted_values, path)
    return result_tree

# Inputs:
# dicts_tree (DataTree de diccionarios)
# key_name (str), por ejemplo 'name'

extracted_tree = extract_key_from_datatree(dicts_tree, key_name)
# ---------- end py3_5 ----------

# ----
# Creates Graph
creates_the_site_graph = Python3Script(
    street_data_tree=downloads_osm.street_attributes_output,
    building_data_tree=downloads_osm.building_attributes_output,
    green_data_tree=downloads_osm.green_space_attributes_output)  # -> out, urban_graph, graph_node_points, graph_edge_lines; inputs street_data_tree: tree, building_data_tree: tree, green_data_tree: tree
# ---------- creates_the_site_graph: Python ----------
import networkx as nx
import Rhino.Geometry as rg
from scipy.spatial import cKDTree
from shapely import wkt as shapely_wkt
from Grasshopper import DataTree

# --- Helper: flatten DataTree to list of dicts ---
def datatree_to_list(tree):
    return [item for branch in tree.Branches for item in branch]

# --- Extract input data ---
streets = datatree_to_list(street_data_tree)
buildings = datatree_to_list(building_data_tree)
greens = datatree_to_list(green_data_tree)

# --- Create graph ---
G = nx.Graph()

# --- Build street nodes with spatial merging ---
street_nodes = []  # (node_id, x, y)
vertex_id_counter = 0
coord_list = []     # (x, y)
id_list = []        # node_id list for KDTree mapping
kdtree = None

tolerance = 0.5  # meters

for s_index, data in enumerate(streets):
    polyline = data.get("geometry")
    if not polyline or polyline.Count < 2:
        continue

    vertex_ids = []

    for i in range(polyline.Count):
        pt = polyline[i]
        x, y = pt.X, pt.Y

        # Use KDTree to check for nearby existing node
        if kdtree and len(coord_list) > 0:
            dist, idx = kdtree.query([x, y], k=1)
            if dist < tolerance:
                node_id = id_list[idx]
            else:
                node_id = f"street_v{vertex_id_counter}"
                vertex_id_counter += 1
                node_data = dict(data)
                node_data["x"] = x
                node_data["y"] = y
                node_data["type"] = "street"
                G.add_node(node_id, **node_data)
                coord_list.append((x, y))
                id_list.append(node_id)
                kdtree = cKDTree(coord_list)
        else:
            node_id = f"street_v{vertex_id_counter}"
            vertex_id_counter += 1
            node_data = dict(data)
            node_data["x"] = x
            node_data["y"] = y
            node_data["type"] = "street"
            G.add_node(node_id, **node_data)
            coord_list.append((x, y))
            id_list.append(node_id)
            kdtree = cKDTree(coord_list)

        vertex_ids.append(node_id)

    # Conectar los segmentos
    for i in range(len(vertex_ids) - 1):
        id1 = vertex_ids[i]
        id2 = vertex_ids[i + 1]
        pt1 = G.nodes[id1]
        pt2 = G.nodes[id2]
        p1 = rg.Point3d(pt1["x"], pt1["y"], 0)
        p2 = rg.Point3d(pt2["x"], pt2["y"], 0)
        line = rg.Line(p1, p2)
        dist = p1.DistanceTo(p2)
        G.add_edge(id1, id2, type="street", distance=dist, geometry=line)

# --- Save final list of street nodes for POI KDTree ---
street_nodes = [(node_id, x, y) for node_id, (x, y) in zip(id_list, coord_list)]
street_coords = [(x, y) for _, x, y in street_nodes]
street_ids = [node_id for node_id, _, _ in street_nodes]
street_kdtree = cKDTree(street_coords)

# --- Add POIs (buildings and green spaces), connected to nearest street node ---
def add_pois(pois, prefix, nodetype):
    for i, data in enumerate(pois):
        wkt_str = data.get("geometry_wkt")
        if not wkt_str:
            continue
        try:
            shapely_geom = shapely_wkt.loads(wkt_str)
            centroid = shapely_geom.centroid
            x, y = centroid.x, centroid.y
        except:
            continue

        node_id = f"{prefix}_{i}"
        data["x"] = x
        data["y"] = y
        data["type"] = nodetype
        G.add_node(node_id, **data)

        # Connect to nearest street node
        dist, idx = street_kdtree.query([x, y], k=1)
        nearest_street_id = street_ids[idx]
        pt1 = rg.Point3d(x, y, 0)
        street_pt = G.nodes[nearest_street_id]
        pt2 = rg.Point3d(street_pt["x"], street_pt["y"], 0)
        line = rg.Line(pt1, pt2)
        G.add_edge(node_id, nearest_street_id, type="access", distance=dist, geometry=line)

add_pois(buildings, "building", "building")
add_pois(greens, "green", "green_space")

# --- Extract geometry for Rhino visualization ---
graph_node_points = [
    rg.Point3d(data["x"], data["y"], 0)
    for _, data in G.nodes(data=True)
    if "x" in data and "y" in data
]

graph_edge_lines = []
for u, v, attrs in G.edges(data=True):
    geom = attrs.get("geometry", None)
    if geom:
        graph_edge_lines.append(geom)

# --- Final outputs ---
urban_graph = G
# ---------- end creates_the_site_graph ----------
panel_2 = Panel(py3_3.g)

# ---- group: Extract Geometry
py3_6 = Python3Script(dicts_tree=py3_2.urban_node_dicts_tree)  # -> out, geometries_tree; inputs dicts_tree: tree; same code as extract_geometry

py3_7 = Python3Script(dicts_tree=py3_2.street_edge_dicts_tree)  # -> out, geometries_tree; inputs dicts_tree: tree; same code as extract_geometry

# ---- group: Extract key
py3_8 = Python3Script(dicts_tree=py3_2.street_edge_dicts_tree, key_name="name")  # -> out, extracted_tree; inputs dicts_tree: tree, key_name: String; same code as py3_5

# ----
crv_8 = Curve(py3_4.geometries_tree)
pull = PullPoint(Point=graft(pt), Geometry=crv_7, ClosestOnly=True)  # -> ClosestPoint, Distance, Index
crv_9 = Curve(py3_6.geometries_tree)
crv_10 = Curve(graft(py3_3.a))
crv_11 = Curve(py3_7.geometries_tree)
relay = Relay()
pt_2 = Point(creates_the_site_graph.graph_node_points)
crv_12 = Curve(creates_the_site_graph.graph_edge_lines)
panel_3 = Panel(py3_2.street_edge_dicts_tree)
preview_3 = CustomPreview(
    Geometry=crv_9,
    Material={diffuse=RGB(221, 160, 221), emission=RGB(66, 48, 66), shine=0.5, specular=RGB(255, 255, 255), transparency=0})
long = LongestList(ListA=pt, ListB=simplify(pull.ClosestPoint), PaddingMode=2)  # -> ListA, ListB
midpt = CurveMiddle(Curve=crv_11)
midpt_2 = CurveMiddle(Curve=crv_10)

# ---- group: Extract Geometry
py3_9 = Python3Script(dicts_tree=relay)  # -> out, geometries_tree; inputs dicts_tree: tree; same code as extract_geometry

# ---- group: Extract key
py3_10 = Python3Script(dicts_tree=relay, key_name="name")  # -> out, extracted_tree; inputs dicts_tree: tree, key_name: String; same code as py3_5

# ----
previewlw_2 = CustomPreviewLineweights(Geometry=[pt_2, crv_12], Shader=ColourSwatch(SwatchColor=RGB(0, 0, 0)), Absolute=False)
merge = Merge(Data1=long.ListA, Data2=simplify(pull.ClosestPoint))
cullpt = CullDuplicates(Points=flatten(midpt), Tolerance=0.1, CullMode=1)  # -> Points, Indices, Valence
crv_13 = Curve(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)
crv_14 = Curve(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)
crv_15 = Curve(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)
cullpt_2 = CullDuplicates(Points=flatten(midpt_2), Tolerance=0.1, CullMode=1)  # -> Points, Indices, Valence
cps = ClosestPoints(Point=graft(pt), Cloud=merge, Count="2")  # -> ClosestPoint, CPIndex, Distance
swatch = ColourSwatch(SwatchColor=RGB(255, 0, 0))
crv_16 = Curve(py3_9.geometries_tree)
item_2 = ListItem(List=flatten(crv_11), Index=cullpt.Indices, Wrap=True)
item_3 = ListItem(List=flatten(crv_10), Index=cullpt_2.Indices, Wrap=True)
explode = Explode(Curve=item_2, Recursive=True)  # -> Segments, Vertices
midpt_3 = CurveMiddle(Curve=crv_16)
explode_2 = Explode(Curve=item_3, Recursive=True)  # -> Segments, Vertices
item_4 = ListItem(List=cps.ClosestPoint, Index="1", Wrap=True)
# Evaluates within Curve
evaluates_the_graph_within_curve = Python3Script(urban_graph=creates_the_site_graph.urban_graph, boundary_curve=crv_14)  # -> out, score_output, nodes_inside_output, edges_inside_output; inputs boundary_curve: Curve
# ---------- evaluates_the_graph_within_curve: Python ----------
import Rhino.Geometry as rg
from Grasshopper import DataTree
from Grasshopper.Kernel.Data import GH_Path
from networkx import shortest_path_length
import networkx as nx  # <--- agregado

# --- Inputs ---
# urban_graph: networkx.Graph
# boundary_curve: rg.Curve (closed, planar)

# --- Initialize trees ---
nodes_inside_tree = DataTree[object]()
edges_inside_tree = DataTree[object]()

if urban_graph and boundary_curve and boundary_curve.IsClosed:

    node_ids_inside = set()

    # --- Step 1: collect nodes inside ---
    for i, (node_id, data) in enumerate(urban_graph.nodes(data=True)):
        if "x" in data and "y" in data:
            pt = rg.Point3d(data["x"], data["y"], 0)
            if boundary_curve.Contains(pt) == rg.PointContainment.Inside:
                node_dict = dict(data)
                node_dict["id"] = node_id
                node_ids_inside.add(node_id)
                nodes_inside_tree.Add(node_dict, GH_Path(0, i))

    # --- Step 2: collect edges where both ends are inside ---
    for j, (u, v, attrs) in enumerate(urban_graph.edges(data=True)):
        if u in node_ids_inside and v in node_ids_inside:
            edge_dict = dict(attrs)
            edge_dict["source"] = u
            edge_dict["target"] = v
            edges_inside_tree.Add(edge_dict, GH_Path(1, j))

# --- GRAFO DEBUG: análisis de conectividad ---
total_nodes = urban_graph.number_of_nodes()
total_edges = urban_graph.number_of_edges()
connected_components = list(nx.connected_components(urban_graph))
num_components = len(connected_components)
largest_component_size = max(len(comp) for comp in connected_components)

print("📊 DEBUG GRAFO")
print("Total nodes:", total_nodes)
print("Total edges:", total_edges)
print("Connected components:", num_components)
print("Largest component size:", largest_component_size)

# --- SCORE CALCULATION ---

compatibility_matrix = {
    "Cultural": {"Cultural": 0.50, "Leisure": 0.92, "Office": 0.75, "Residential": 1.00, "Green": 0.83},
    "Leisure": {"Cultural": 0.92, "Leisure": 0.66, "Office": 0.83, "Residential": 0.92, "Green": 1.00},
    "Office": {"Cultural": 0.75, "Leisure": 0.83, "Office": 0.41, "Residential": 0.83, "Green": 0.66},
    "Residential": {"Cultural": 1.00, "Leisure": 0.91, "Office": 0.83, "Residential": 0.50, "Green": 1.00},
    "Green": {"Cultural": 0.83, "Leisure": 1.00, "Office": 0.66, "Residential": 1.00, "Green": 0.58}
}

node_weights = {
    "Cultural": 1.2,
    "Leisure": 1.1,
    "Office": 1.0,
    "Residential": 0.9,
    "Green": 1.3
}

def categorize_node(data):
    tags = {k.lower(): str(v).lower() for k, v in data.items()}
    building = tags.get("building")

    residential_buildings = {
        "apartments", "house", "residential", "semidetached_house",
        "terrace", "bungalow", "detached", "dormitory"
    }
    office_buildings = {
        "office", "commercial", "industrial", "retail",
        "manufacture", "warehouse", "service"
    }
    cultural_buildings = {
        "college", "school", "kindergarten", "government",
        "civic", "church", "fire_station", "prison"
    }
    leisure_buildings = {
        "hotel", "boathouse", "houseboat", "bridge"
    }
    green_buildings = {
        "greenhouse", "allotment_house"
    }

    if building == "yes":
        return "Residential"
    if building in residential_buildings:
        return "Residential"
    elif building in office_buildings:
        return "Office"
    elif building in cultural_buildings:
        return "Cultural"
    elif building in leisure_buildings:
        return "Leisure"
    elif building in green_buildings:
        return "Green"
    if any(kw in tags.get("amenity", "") for kw in ["museum", "theatre", "gallery"]):
        return "Cultural"
    if any(kw in tags.get("leisure", "") for kw in ["park", "recreation", "garden"]):
        return "Leisure"
    if tags.get("landuse") in ["grass", "meadow"] or "green" in tags.get("type", ""):
        return "Green"
    return None

# --- DEBUG INFO ---
print("Nodos dentro de la curva:", len(node_ids_inside))

# --- Categorize nodes inside ---
typed_nodes = {}
for node_id, data in urban_graph.nodes(data=True):
    if node_id in node_ids_inside:
        category = categorize_node(data)
        if category in node_weights:
            typed_nodes[node_id] = category

print("Nodos categorizados (typed_nodes):", len(typed_nodes))

# --- Calculate score using shortest paths between typed nodes ---
score_sum = 0.0
pair_count = 0
path_found_count = 0
typed_node_ids = list(typed_nodes.keys())
total_pairs = 0

for i in range(len(typed_node_ids)):
    for j in range(i + 1, len(typed_node_ids)):
        u = typed_node_ids[i]
        v = typed_node_ids[j]
        total_pairs += 1
        try:
            dist = shortest_path_length(urban_graph, source=u, target=v, weight='distance')
            if dist > 0:
                type_u = typed_nodes[u]
                type_v = typed_nodes[v]
                k_u = node_weights[type_u]
                k_v = node_weights[type_v]
                f_uv = compatibility_matrix[type_u][type_v]
                contribution = (k_u * k_v * f_uv) / dist
                score_sum += contribution
                pair_count += 1
                path_found_count += 1
                print(f"✔ Path {u} → {v}: dist={dist:.2f}, types=({type_u}, {type_v}), score+={contribution:.4f}")
        except:
            print(f"✘ No path between {u} and {v}")
            continue

node_count = len(typed_nodes)

print("Total typed node pairs:", total_pairs)
print("Paths found:", path_found_count)
print("Total score_sum:", score_sum)
print("Final node_count:", node_count)
print("Final pair_count:", pair_count)

if node_count > 0 and pair_count > 0:
    score = score_sum / (node_count * pair_count)
else:
    score = 0.0

print("SCORE:", score)

# --- Outputs ---
nodes_inside_output = nodes_inside_tree
edges_inside_output = edges_inside_tree
score_output = score
# ---------- end evaluates_the_graph_within_curve ----------
len = Length(Curve=explode.Segments)
cullpt_3 = CullDuplicates(Points=flatten(midpt_3), Tolerance=0.1, CullMode=1)  # -> Points, Indices, Valence
len_2 = Length(Curve=explode_2.Segments)
previewlw_3 = CustomPreviewLineweights(Geometry=crv_14, Shader=swatch, Thickness=Slider(4, range=0..10), Absolute=False)
ln = Line(StartPoint=graft(pt), EndPoint=item_4)  # -> flatten(Line)
sort = SortList(Keys=len, ValuesA=explode.Segments)  # -> Keys, reverse(ValuesA)
sort_2 = SortList(Keys=len_2, ValuesA=explode_2.Segments)  # -> Keys, reverse(ValuesA)
item_5 = ListItem(List=sort.ValuesA, Index=0, Wrap=True)
item_6 = ListItem(List=sort_2.ValuesA, Index=0, Wrap=True)
item_7 = ListItem(List=flatten(crv_16), Index=cullpt_3.Indices, Wrap=True)
join = JoinCurves(Curves=ln, Preserve=False)
crv_17 = Curve(py3.edges_buildings)
crv_18 = Curve(py3.buildings)
explode_3 = Explode(Curve=item_5, Recursive=True)  # -> Segments, Vertices
explode_4 = Explode(Curve=item_6, Recursive=True)  # -> Segments, Vertices
explode_5 = Explode(Curve=join, Recursive=True)  # -> Segments, Vertices
extract_geometry_4 = Python3Script(dicts_tree=evaluates_the_graph_within_curve.nodes_inside_output)  # -> out, geometries_tree; inputs dicts_tree: tree
# ---------- extract_geometry_4: Python ----------
from Grasshopper import DataTree
from Grasshopper.Kernel.Data import GH_Path

def extract_geometries(dicts_tree):
    geometries_tree = DataTree[object]()
    for path in dicts_tree.Paths:
        items = dicts_tree.Branch(path)
        for i, d in enumerate(items):
            # Force to real Python dict if necessary
            try:
                py_dict = dict(d)  # Converts from System.Collections.Generic.Dictionary
            except:
                py_dict = d  # If already a Python dict
            geom = py_dict.get('geometry', None)
            geometries_tree.Add(geom, path)
    return geometries_tree

# Output
geometries_tree = extract_geometries(dicts_tree)
# ---------- end extract_geometry_4 ----------
data = Data(evaluates_the_graph_within_curve.score_output)
extract_geometry_5 = Python3Script(dicts_tree=evaluates_the_graph_within_curve.edges_inside_output)  # -> out, geometries_tree; inputs dicts_tree: tree; same code as extract_geometry_4
explode_6 = Explode(Curve=item_7, Recursive=True)  # -> Segments, Vertices
pdecon = Deconstruct(Point=explode_3.Vertices)  # -> XComponent, YComponent, ZComponent
pt_3 = Point([Point(240793.1514, 5068155.908, 0), Point(240814.8899, 5068152.987, 0), Point(240874.8611, 5068211.049, 0), Point(240817.6542, 5068277.526, 0), Point(240839.1407, 5068253.117, 0), Point(240857.1572, 5068204.577, 0)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])
pdecon_2 = Deconstruct(Point=explode_4.Vertices)  # -> XComponent, YComponent, ZComponent
panel_4 = Panel(data)
panel_5 = Panel(evaluates_the_graph_within_curve.nodes_inside_output)
sort_3 = SortList(Keys=pdecon.XComponent, ValuesA=explode_3.Vertices)  # -> Keys, ValuesA
pull_2 = PullPoint(Point=explode_5.Vertices, Geometry=crv_7, ClosestOnly=True)  # -> ClosestPoint, Distance, Index
len_3 = Length(Curve=explode_6.Segments)
sort_4 = SortList(Keys=pdecon_2.XComponent, ValuesA=explode_4.Vertices)  # -> Keys, ValuesA
item_8 = ListItem(List=sort_3.ValuesA, Index=0, Wrap=True)  # -> Item, Item1
item_9 = ListItem(List=sort_4.ValuesA, Index=0, Wrap=True)  # -> Item, Item1
sort_5 = SortList(Keys=pull_2.Distance)  # -> Keys, ValuesA
sort_6 = SortList(Keys=len_3, ValuesA=explode_6.Segments)  # -> Keys, reverse(ValuesA)

# ---- group: Overrides .graphml
py3_11 = Python3Script(updated_points=pt_3, node_ids=py3.edges_buildings, original_graphml=path, save_path=path, save_trigger=Button())  # -> out, a, b, c; inputs updated_points: list, node_ids: list, original_graphml: String, save_path: String, save_trigger: Boolean
# ---------- py3_11: Python ----------
# ----------------------------
# Node B: Save GraphML (Writer)
# ----------------------------
import networkx as nx
import os
import rhinoscriptsyntax as rs

def save_graph(updated_points, node_ids, original_graphml, save_path):
    # Check inputs
    if not os.path.exists(original_graphml):
        raise ValueError("Original GraphML file not found: " + original_graphml)
    if len(updated_points) != len(node_ids):
        raise ValueError("Number of updated points does not match number of node IDs.")

    # Load original graph
    G = nx.read_graphml(original_graphml)

    # Update node positions
    for pt_ref, node_id in zip(updated_points, node_ids):
        # Convert GUID reference to Point3d
        pt = rs.coerce3dpoint(pt_ref)
        if pt:  # Ensure conversion succeeded
            if node_id in G.nodes:
                G.nodes[node_id]["x"] = pt.X
                G.nodes[node_id]["y"] = pt.Y
        else:
            raise ValueError("Invalid point reference for node: " + str(node_id))

    # Write updated graph
    nx.write_graphml(G, save_path)
    print("GraphML saved successfully to:", save_path)

# Inputs:
# updated_points: List of Point3d or GUIDs (edited in Rhino)
# node_ids: List of node IDs (from Node A)
# original_graphml: Path to original .graphml
# save_path: Path to save updated .graphml
# save_trigger: Boolean button to trigger save

if save_trigger:
    save_graph(updated_points, node_ids, original_graphml, save_path)
# ---------- end py3_11 ----------

# ----
preview_4 = CustomPreview(Geometry=extract_geometry_5.geometries_tree, Material=swatch)
preview_5 = CustomPreview(Geometry=extract_geometry_4.geometries_tree, Material=swatch)
ln_2 = Line(StartPoint=item_8.Item, EndPoint=item_8.Item1)  # -> flatten(Line)
item_10 = ListItem(List=sort_5.Keys, Index=0, Wrap=True)
ln_3 = Line(StartPoint=item_9.Item, EndPoint=item_9.Item1)  # -> flatten(Line)
item_11 = ListItem(List=sort_6.ValuesA, Index=0, Wrap=True)
explode_7 = Explode(Curve=item_11, Recursive=True)  # -> Segments, Vertices
panel_6 = Panel(py3.nodes_streets)
equals = Equality(FirstNumber=item_10, SecondNumber="0")  # -> Equality, Inequality
midpt_4 = CurveMiddle(Curve=ln_2)
equalst = EqualityWithinTolerance(FirstNumber=item_10, SecondNumber="0", Tolerance="1")  # -> Equality, Inequality
midpt_5 = CurveMiddle(Curve=ln_3)
pdecon_3 = Deconstruct(Point=explode_7.Vertices)  # -> XComponent, YComponent, ZComponent
sort_7 = SortList(Keys=pdecon_3.XComponent, ValuesA=explode_7.Vertices)  # -> Keys, ValuesA
pl = ConstructPlane(Origin=midpt_4, XAxis=ln_2, YAxis=Vector(0, 1, 0))  # -> graft(Plane)
pl_2 = ConstructPlane(Origin=midpt_5, XAxis=ln_3, YAxis=Vector(0, 1, 0))  # -> graft(Plane)
item_12 = ListItem(List=sort_7.ValuesA, Index=0, Wrap=True)  # -> Item, Item1
dispatch = Dispatch(List=join, DispatchPattern=flatten(equalst.Equality))  # -> ListA, ListB
tag = TextTag3D(Location=pl, Text=py3_8.extracted_tree, Size="2", Colour=ColourSwatch(SwatchColor=RGB(0, 0, 0)), Justification=5)
ln_4 = Line(StartPoint=item_12.Item, EndPoint=item_12.Item1)  # -> flatten(Line)
tag_2 = TextTag3D(Location=pl_2, Text=py3_5.extracted_tree, Size="2", Colour=ColourSwatch(SwatchColor=RGB(0, 0, 0)), Justification=5)
crv_19 = Curve(dispatch.ListB)
midpt_6 = CurveMiddle(Curve=ln_4)
explode_8 = Explode(Curve=crv_19, Recursive=True)  # -> Segments, Vertices
pl_3 = ConstructPlane(Origin=midpt_6, XAxis=ln_4, YAxis=Vector(0, 1, 0))  # -> graft(Plane)
pull_3 = PullPoint(Point=explode_8.Vertices, Geometry=crv_7, ClosestOnly=True)  # -> ClosestPoint, Distance, Index
tag_3 = TextTag3D(Location=pl_3, Text=py3_10.extracted_tree, Size="2", Colour=ColourSwatch(SwatchColor=RGB(0, 0, 0)), Justification=5)
sort_8 = SortList(Keys=pull_3.Distance, ValuesB=explode_8.Vertices, ValuesA=pull_3.ClosestPoint)  # -> Keys, ValuesB, ValuesA
item_13 = ListItem(List=sort_8.ValuesB, Index=0, Wrap=True)
item_14 = ListItem(List=sort_8.ValuesA, Index=0, Wrap=True)
ln_5 = Line(StartPoint=item_13, EndPoint=item_14)
join_2 = JoinCurves(Curves=flatten([crv_19, ln_5]), Preserve=False)
crv_20 = Curve(dispatch.ListA)
merge_2 = Merge(Data1=crv_20, Data2=join_2)
