# Grasshopper definition 3Dto3D.gh (Grasshopper 1.0.8)

default = GeometryPipeline(
    GroupByLayer=False,
    GroupByType=False,
    IncludeHidden=True,
    IncludeLocked=True,
    LayerFilter="*Default",
    NameFilter="*",
    SublayerFiltering=True,
    TypeFilter=1073741848)
python_3_script = Python3Script(brep=default)  # -> out, flatten(a)
# ---------- python_3_script: Python ----------
import Rhino.Geometry as rg
floor_height = 3
tolerance = 0.001

# Make sure breps is a list
breps = brep if isinstance(brep, list) else [brep]

# Convert Extrusions to Breps
breps_cleaned = []
for b in breps:
    if isinstance(b, rg.Extrusion):
        breps_cleaned.append(b.ToBrep())
    else:
        breps_cleaned.append(b)

# Get combined bounding box
combined_bbox = rg.BoundingBox.Unset
for b in breps_cleaned:
    combined_bbox = rg.BoundingBox.Union(combined_bbox, b.GetBoundingBox(True))

z_min = combined_bbox.Min.Z
z_max = combined_bbox.Max.Z
height = z_max - z_min

# Generate floor levels based on floor_height
num_floors = int(height // floor_height)
floor_levels = [z_min + i * floor_height for i in range(1, num_floors + 1)]

# Create slicing planes (as Brep surfaces)
splitters = []
for z in floor_levels:
    plane = rg.Plane(rg.Point3d(0, 0, z), rg.Vector3d.ZAxis)
    surface = rg.PlaneSurface(plane, rg.Interval(-1e6, 1e6), rg.Interval(-1e6, 1e6))
    brep_surface = rg.Brep.CreateFromSurface(surface)
    splitters.append(brep_surface)

# Slice breps
sliced_breps = []
for b in breps_cleaned:
    result = rg.Brep.CreateBooleanSplit([b], splitters, tolerance)
    if result:
        sliced_breps.extend(result)
    else:
        sliced_breps.append(b)

# Output
a = sliced_breps
# ---------- end python_3_script ----------
bake = Python3Script(sliced_breps=python_3_script.a, bake_trigger=Button())  # -> out, a; inputs sliced_breps: list
# ---------- bake: Python ----------
import Rhino
import scriptcontext as sc
import System

# Use sticky dictionary to track state between runs
sticky_key = "copilot_bake_done"

# Check if bake should happen
bake_now = bake_trigger and not sc.sticky.get(sticky_key, False)

if bake_now and sliced_breps:
    # Switch to Rhino doc
    ghdoc = sc.doc
    sc.doc = Rhino.RhinoDoc.ActiveDoc

    # Layer setup
    parent_name = "Copilot Name TBD"
    child_name = "Residential"
    full_layer = f"{parent_name}::{child_name}"
    layer_table = sc.doc.Layers

    # Create parent layer
    parent_index = layer_table.FindByFullPath(parent_name, -1)
    if parent_index == -1:
        parent_layer = Rhino.DocObjects.Layer()
        parent_layer.Name = parent_name
        parent_index = layer_table.Add(parent_layer)

    # Create sublayer
    office_index = layer_table.FindByFullPath(full_layer, -1)
    if office_index == -1:
        office_layer = Rhino.DocObjects.Layer()
        office_layer.Name = child_name
        office_layer.ParentLayerId = layer_table[parent_index].Id
        office_layer.Color = System.Drawing.Color.Red
        office_index = layer_table.Add(office_layer)

    # Set attributes
    attr = Rhino.DocObjects.ObjectAttributes()
    attr.LayerIndex = office_index

    # Bake each brep
    for brep in sliced_breps:
        if brep:
            sc.doc.Objects.AddBrep(brep.DuplicateBrep(), attr)

    sc.doc.Views.Redraw()
    sc.doc = ghdoc

# Update sticky state: True if button is pressed, False if released
sc.sticky[sticky_key] = bake_trigger
# ---------- end bake ----------
